# Grasshopper definition FDM.ghx (Grasshopper 1.0.7)

ghpython_script = PythonScript()  # -> rhino_doc_dir
# ---------- ghpython_script: Python ----------
import scriptcontext as sc
from os import path

rhino_doc_dir = path.abspath(path.dirname(sc.doc.Path))
# ---------- end ghpython_script ----------

# ---- group: fixed nodes
point = Point([<point referenced from the Rhino model> x4])

# ---- group: all edge elements
curve = Curve([<curve referenced from the Rhino model> x60])

# ----
# Force Density Method
# 
# 4.450 Fall 2019,  Yijiang Huang & Pierre Cuvilliers
# Finds the equilibrium shape of a network of bars using the force density method.
# 
# Arguments:
#       export (bool) : if True save the initial data (required to run FDM) to a json file
#       save_data_folder (string): folder to save the json file
#       compute_fdm (bool): if True, trigger the compute_fdm function directly
#       nodes (list of points):  All nodes (fixed and free) that the FDM acts on.
#       edges (list of curves): Lines connecting nodes together, and defining the
#             connectivity of the network. All end points of edges should be in nodes.
#             The connectivity is defined between endpoints of the line, points simply
#             along the line are not connected.
#       fixed_nodes (list of points): a list of fixed points, should be a subset of nodes
#       force_densities (scalar or list of scalar): The force densities. Can be one scalar
#             value that will be assigned to all edges, or a list of values, one for each edge.
#       loads (vector or list of vectors): The loads applied to the nodes of the network.
#             Can be one vector applied to all nodes, or a list of vectors, one for each node.
# 
# Returns:
#       optimized_nodes: The nodes in their equilibrium positions
#       optimized_lines: The edges in their equilibrium positions
concatenate = Concatenate(FragmentA=ghpython_script, FragmentB="\pyfdm\tests")

# ---- group: Choose one load (applied to all points) or a list of loads (one per point)
gene_pool = GenePool(Decimals=2, Maximum=1, Minimum=0, Value=[0.5, 1, 0.5, 0.5, 0.13, 0.5, 0.5, 0.5, 0.5, 0.5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])
unit_z = UnitZ(Factor="+1")
unit_z_2 = UnitZ(Factor=gene_pool)
loads = Data(unit_z)
vector = Vector(loads)

# ---- group: Choose one q (applied to all points) or a list of qs
q = Slider(0.672, range=0.001..1)
gene_pool_2 = GenePool(Decimals=2, Maximum=1, Minimum=0, Value=[0.5, 0.29, 0.77, 0.1, 0.5, 0.04, 0.8, 0.2, 0.57, 0.15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])
force_densities = Data(q)
number = Number(force_densities)

# ----
panel = Panel(concatenate)

# ---- group: get unduplicated nodes
curve_curve = CurveCurve(CurveA=curve, CurveB=curve)  # -> Points, ParamsA, ParamsB
create_set = CreateSet(List=flatten(curve_curve.Points))  # -> Set, Map

# ----
export_initial_condition = BooleanToggle(False)
trigger_computation = BooleanToggle(True)
python_script = PythonScript(
    export=export_initial_condition,
    save_data_folder=panel,
    compute_fdm=trigger_computation,
    nodes=create_set.Set,
    edges=curve,
    fixed_nodes=point,
    force_densities=number,
    loads=vector)  # -> out, optimized_lines, optimized_nodes; inputs nodes: list, edges: list of Curve, fixed_nodes: list of Point3d, force_densities: list, loads: list of Vector3d
# ---------- python_script: Python ----------
import Rhino.Geometry as rg
import Rhino.Collections.Point3dList as Point3dList
import rhinoscriptsyntax as rs

#########################################
# CONVERTING RHINO/GH DATA TO PYTHON DATA
#########################################

# import rhino objects
rhnodes = rs.coerce3dpointlist(nodes, True)
rhedges = [rs.coerceline(edge) for edge in edges]
rhsupport = rs.coerce3dpointlist(fixed_nodes, True)

nn = len(nodes)
ne = len(edges)

# Create Connectivity matrix
edge_node_ids = []
for (i, edge) in enumerate(rhedges):
    istart = Point3dList.ClosestIndexInList(rhnodes, edge.From)
    iend   = Point3dList.ClosestIndexInList(rhnodes, edge.To)
    edge_node_ids.append([istart, iend])

# Construct coordinate matrix
node_coord = []
for i, node in enumerate(rhnodes):
    node_coord.append([node.X, node.Y, node.Z])
#print(node_coord)

# Construct force vector
nodal_loads = []
for load in loads:
    nodal_loads.append([load.X, load.Y, load.Z])

# Force Densities
q = force_densities

# Fix nodes
fixed = []
for support_pt in rhsupport:
    for (i, node) in enumerate(rhnodes):
        if (support_pt - node).IsTiny():
            fixed.append(i)

#########################################
# EXPORT DATA
#########################################
if export:
    import os
    import json
    data = {}
    data['edge_node_ids'] = edge_node_ids
    data['node_coord'] = node_coord
    data['nodal_loads'] = nodal_loads
    data['force_densities'] = q
    data['fixed_node_ids'] = fixed
    file_path = os.path.join(save_data_folder, 'fdm_init_data.json')
    with open(file_path, 'w') as outfile:
        json.dump(data, outfile, indent=4)
    print('init data saved to: {}'.format(os.path.join(save_data_folder, 'fdm_init_data.json')))

#########################################
# TRIGGER COMPUTATION
#########################################
if compute_fdm:
    from compas.rpc import Proxy
    pyfdm = Proxy('pyfdm', python='python') # , capture_output=True
    fdm_node_coord = pyfdm.compute_fdm(node_coord, edge_node_ids, nodal_loads, force_densities, fixed)
    
    # Draw
    optimized_nodes = [rg.Point3d(ncoord[0], ncoord[1], ncoord[2]) for ncoord in fdm_node_coord]
    optimized_lines = []
    for i_id in edge_node_ids:
        l = rg.Line(rg.Point3d(fdm_node_coord[i_id[0]][0],
                               fdm_node_coord[i_id[0]][1],
                               fdm_node_coord[i_id[0]][2]),
                    rg.Point3d(fdm_node_coord[i_id[1]][0],
                               fdm_node_coord[i_id[1]][1],
                               fdm_node_coord[i_id[1]][2]))
        optimized_lines.append(l)
# ---------- end python_script ----------

# ---- group: visualize force density
cluster = Cluster(curve=python_script.optimized_lines, number=number)  # -> point, result
text_tag_3d = TextTag3D(Location=cluster.point, Text=cluster.result, Size=Slider(0.1, range=0..1), Justification=7)

# ----
panel_2 = Panel(python_script.out)
panel_3 = Panel(python_script.optimized_lines)

# ---- group: visualize load vectors
colour_cmyk = ColourCMYK(Cyan=1, Magenta=0, Yellow=0, Key=0)
point_2 = Point(python_script.optimized_nodes)
vector_display_ex = VectorDisplayEx(Point=point_2, Vector=vector, Colour=colour_cmyk, Width=2)

# ---- group: visualize load vectors on the initial grid
vector_display_ex_2 = VectorDisplayEx(Point=flatten(curve_curve.Points), Vector=vector, Colour=colour_cmyk, Width=2)

# ----
list_item = ListItem(List=python_script.optimized_lines, Index=Slider(1, range=0..100), Wrap=True)

# ==== cluster Cluster
curve = ClusterInput()
number = ClusterInput()
curve_2 = Curve(reparameterize(curve))
number_2 = Number(number)
concatenate = Concatenate(FragmentA="q:", FragmentB=number_2)
evaluate_curve = EvaluateCurve(Curve=curve_2, Parameter="0.5")  # -> Point, Tangent, Angle
result = ClusterOutput(concatenate)
point = ClusterOutput(evaluate_curve.Point)
