# Grasshopper definition kangaroo2_shell_form_finding.gh (Grasshopper 1.0.7)
# plug-ins: Kangaroo2 Components

# ---- group: fixed nodes
point = Point([<point referenced from the Rhino model> x4])

# ---- group: all edge elements
# Surface form-finding with Kangaroo
# 
# 4.450 Fall 2019
# Pierre Cuvilliers & Yijiang Huang
# Finds the equilibrium shape of a network of bars using Kangaroo iterative solver.
curve = Curve([<curve referenced from the Rhino model> x60])

# ---- group: get unduplicated nodes
curve_curve = CurveCurve(CurveA=curve, CurveB=curve)  # -> Points, ParamsA, ParamsB
create_set = CreateSet(List=flatten(curve_curve.Points))  # -> Set, Map

# ----
point_2 = Point(create_set.Set)
gene_pool = GenePool(Decimals=2, Maximum=1.2, Minimum=0.9, Value=[1.2, 1.07, 1.09, 1.2, 0.92, 1.01, 0.92, 1.16, 1.2, 0.9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])
curve_2 = Curve(curve)
anchors = Point(point)
length = Length(Curve=curve_2)
unit_z = UnitZ(Factor="10")
multiplication = Multiplication(A=length, B="1")
anchor = Anchor(Point=anchors, Strength=1e+10)
length_line = LengthLine(Line=curve_2, Length=multiplication, Strength=1000)
load = Load(Point=point_2, ForceVector=unit_z)
merge = Merge(Data2=load, Data3=length_line, Data4=anchor)  # -> flatten(Result)
solver = Solver(GoalObjects=merge, Reset=Button(), Threshold=1e-15, Tolerance=0.01, On=Toggle(True))  # -> I, V, O
point_3 = Point(solver.V)
curve_3 = Curve(solver.O)

# ---- group: visualize load vectors
multiplication_2 = Multiplication(A=unit_z, B=Slider(0.1, range=0..1))
colour_cmyk = ColourCMYK(Cyan=1, Magenta=0, Yellow=0, Key=0)
point_4 = Point(point_3)
vector_display_ex = VectorDisplayEx(Point=point_4, Vector=multiplication_2, Colour=colour_cmyk, Width=2)

# ---- group: visualize force density
number = Number(multiplication)
cluster = Cluster(curve=curve_3, number=number)  # -> point, result
text_tag_3d = TextTag3D(Location=cluster.point, Text=cluster.result, Size=Slider(0.2, range=0..1), Justification=7)

# ==== cluster Cluster
curve = ClusterInput()
number = ClusterInput()
curve_2 = Curve(reparameterize(curve))
number_2 = Number(number)
concatenate = Concatenate(FragmentA="s:", FragmentB=number_2)
evaluate_curve = EvaluateCurve(Curve=curve_2, Parameter="0.5")  # -> Point, Tangent, Angle
result = ClusterOutput(concatenate)
point = ClusterOutput(evaluate_curve.Point)
